# Grasshopper definition master_file.gh (Grasshopper 1.0.7)

expression = Expression(Expression="π")

# ----
# IMPORT_OBJ
# Rotate if necesary
rotate_bool = BooleanToggle(False)
# Right_click / select existing file
file_path = FilePath("C:\Users\JesusBarney\Desktop\ETH\THESIS\08_Github\eggShell2.0\06_Prints\20190808_frstCastingTest_lessOverhanging.OBJ")
# Scale factor
scale_factor_mesh = Slider(1, range=0..15)
python_script = PythonScript(path=file_path, rotate_bool=rotate_bool, rotate_angle=expression, scale_factor=scale_factor_mesh)  # -> out, mesh, z_values, face_centers; inputs rotate_bool: Boolean
# ---------- python_script: Python ----------
import importObj
reload(importObj)

from importObj import ImportObj
import Rhino.Geometry as rg

imported_mesh = ImportObj(path, rotate_bool, scale_factor)

imported_mesh.import_obj()

if rotate_bool:
    
    imported_mesh.rotate_mesh(rotate_angle)

if scale_factor != 1:
    
    imported_mesh.scale_mesh()

imported_mesh.get_bounding_box()

imported_mesh.move_mesh()

imported_mesh.calc_normals()

z_values = imported_mesh.z_values
face_centers = imported_mesh.face_centers
mesh = imported_mesh.mesh
# ---------- end python_script ----------
# SLICER
mesh = Mesh(python_script.mesh)

number_slider = Slider(428, range=0..1000)

# ---- group: check correct printing part, then SEND
data_dam = DataDam(DataDataA=mesh, BufferDelay=10000000, BufferMode=0)

# ----
write_file = Button()
mesh_2 = Mesh(data_dam)
directory_path = FilePath("C:\Users\JesusBarney\Desktop\ETH\THESIS\08_Github\eggShell2.0\04_Code\02_Slicer\data\")

# ----
# SLOPE_VISUALIZATION
toggle = BooleanToggle(False)
cull = CullPattern(List=python_script.z_values, CullPattern=toggle)
gradient = Gradient(
    LowerLimit=0,
    UpperLimit=1,
    Parameter=expr("(1-abs(x))", cull),
    stops=[0: RGB(255, 0, 0), 0.114: RGB(253, 54, 40), 0.473: RGB(255, 255, 0), 0.895: RGB(0, 128, 0)])
preview = CustomPreview(Geometry=python_script.face_centers, Shader=gradient)

# ----
# SLICER
python = GhPythonScript(mesh=mesh_2, write_file=write_file, dir_path=directory_path)  # -> out, slice, contour_curves, all_points, seams, layer_height; inputs mesh: Mesh, write_file: Boolean
# ---------- python: Python ----------
"""import Slice
"""
import slice
reload(slice)
from slice import Slice

import slice_args
reload(slice_args)
from slice_args import sliceargs

"""import writeTxt
"""
import writeTxt
reload(writeTxt)
from writeTxt import WriteTxt

import write_text_args
reload(write_text_args)
from write_text_args import writetxtargs

"""import generateWCS
"""
import generateWCS
reload(generateWCS)
from generateWCS import GenerateWCS

import wcs_args
reload(wcs_args)
from wcs_args import wcsargs

"""slice
"""
slice = Slice(**sliceargs)
contour_curves, seams = slice.contour_mesh(mesh)

"""generate WCS frames
"""
generateWCS = GenerateWCS(**wcsargs)
WCS_list, all_points = generateWCS.generate_WCS_list(contour_curves)

"""write txt file
"""
if write_file:
    
    writetxtargs['data']      = WCS_list
    writetxtargs['dir_path']  = dir_path
    
    write_txt = WriteTxt(**writetxtargs)
    write_txt.write_txt_file()
# ---------- end python ----------

multiplication = Multiplication(A=Slider(3, range=0..10), B=Slider(88, range=0..100))
neg = Negative(Value=number_slider)

# ---- group: contour_curves
geo = Geometry(python.contour_curves)

# ----
item = ListItem(List=geo, Index=number_slider, Wrap=True)

# ---- group: all_points
geo_2 = Geometry(python.all_points)

# ---- group: seams
geo_3 = Geometry(python.seams)

# ----
pline = PolyLine(Vertices=geo_2, Closed=False)
len = Length(Curve=item)
cls = Closed(Curve=geo)  # -> Closed, Periodic
python_2 = GhPythonScript(curve_list=geo, point_list=geo_2, layer_height=python.layer_height)  # -> out, frame_list; inputs curve_list: list of Curve, point_list: list of Point3d; disabled
# ---------- python_2: Python ----------
import frame
reload(frame)

from frame import Frame

#import slice_args
#reload(slice_args)

#from slice_args import args

#slice = Slice(**args)

frame = Frame(curve_list, point_list, layer_height)

frame_list = frame.tcp_frames
# ---------- end python_2 ----------
python_3 = GhPythonScript(point_list=geo_2, layer_height=python.layer_height)  # -> out, path, point_list; inputs point_list: list of Point3d; disabled
# ---------- python_3: Python ----------
import shortestPath
reload(shortestPath)

from shortestPath import ShortestPath

shortest_path = ShortestPath()

path, height_nested_list = shortest_path.generate_path(point_list, layer_height)

temp_list = []

for h in height_nested_list:
    
    for p in point_list:
        
        temp_list.append(p)
# ---------- end python_3 ----------
division = Division(A=len, B=Slider(35, range=0..100))
panel = Panel(cls.Closed)
panel_2 = Panel(division)
